# Grasshopper definition 01_Vector_follow.gh (Grasshopper 1.0.7)

point = Point(<point referenced from the Rhino model>)
point_2 = Point(<point referenced from the Rhino model>)
vector_2pt = Vector2Pt(PointA=point_2, PointB=point, Unitize=False)  # -> Vector, Length
line = Line(StartPoint=point_2, EndPoint=point)
point_3 = Point(<point referenced from the Rhino model>)
line_sdl = LineSDL(Start=point_3, Direction=vector_2pt.Vector, Length=Slider(100, range=20..100))
