# Grasshopper definition 03_ellips.gh (Grasshopper 1.0.7)

# ----
# Creating a basic ellipical object
point = Point(<point referenced from the Rhino model>)
ellipse = Ellipse(Plane=point, Radius1=Slider(70, range=0..100), Radius2=Slider(100, range=0..100))  # -> Ellipse, Focus1, Focus2

# ---- group: Shows the focal point of ellips
point_2 = Point(ellipse.Focus1)
point_3 = Point(ellipse.Focus2)
