# Grasshopper definition 04_polygon.gh (Grasshopper 1.0.7)

# ----
# Creating the basic polygon
point = Point(<point referenced from the Rhino model>)
polygon = Polygon(Plane=point, Radius=Slider(20, range=20..100), Segments=Slider(3, range=3..100), FilletRadius=Slider(6, range=1..100))  # -> Polygon, Length
