# Grasshopper definition 05_rectangle.gh (Grasshopper 1.0.7)

# ----
# Creating a simple rectangle using rectangle2pt
point = Point(<point referenced from the Rhino model>)
point_2 = Point(<point referenced from the Rhino model>)
rectangle_2pt = Rectangle2Pt(Plane=PlaneXY(0, 0, 0), PointA=point, PointB=point_2, Radius=Slider(1, range=0..1))  # -> Rectangle, Length
