# Grasshopper definition 06_simple_operator.gh (Grasshopper 1.0.7)

number_slider = Slider(100, range=20..100)
point = Point(<point referenced from the Rhino model>)
circle = Circle(Plane=point, Radius=number_slider)
integer = Integer(1000)
number_slider_2 = Slider(100, range=20..100)
addition = Addition(A=number_slider, B=integer)
point_2 = Point(<point referenced from the Rhino model>)
circle_2 = Circle(Plane=point_2, Radius=addition)

# ----
# Using simple operators to show dependencies
number_slider_3 = Slider(1, range=1..100)
addition_2 = Addition(A=number_slider_3, B=Slider(30, range=1..100))
panel = Panel(addition_2)
