# Grasshopper definition 07_series.gh (Grasshopper 1.0.7)

series = Series(Start=0, Step=1, Count=10)
# Constructing points using series
construct_point = ConstructPoint(XCoordinate=series, YCoordinate=series, ZCoordinate=series)
panel = Panel(construct_point)
panel_2 = Panel(series)
