# Grasshopper definition 08_range.gh (Grasshopper 1.0.7)

# ----
# Range divides the domain into equal parts | Domain is like what numbers you want
series = Series(Start=0, Step=1, Count=10)
panel = Panel(series)
construct_point = ConstructPoint(XCoordinate=panel, YCoordinate=0, ZCoordinate=0)

range = Range(Domain=Domain(0, 20), Steps=10)
panel_2 = Panel(range)
construct_point_2 = ConstructPoint(XCoordinate=panel_2, YCoordinate=0, ZCoordinate=0)
