# Grasshopper definition 09_construct_a_domain.gh (Grasshopper 1.0.7)

# ---- group: We can control the start and end of domain value using this construct domain
# Contruct a domain |creates a higher flexibility when doing this
number_slider = Slider(0.25, range=0.25..1)
construct_domain = ConstructDomain(DomainStart=number_slider, DomainEnd=Slider(1, range=0.25..1))

# ----
range = Range(Domain=construct_domain, Steps=10)
panel = Panel(range)
construct_point = ConstructPoint(XCoordinate=panel, YCoordinate=0, ZCoordinate=0)
