# Grasshopper definition 10_using_random_numbers.gh (Grasshopper 1.0.7)

# ---- group: gives variation in the random number we are getting
number_slider = Slider(37, range=0..100)

# ----
# Using random number as in to create variation is radius of a circle
construct_domain = ConstructDomain(DomainStart=Slider(0.25, range=0..1), DomainEnd=Slider(1, range=0..1))
random = Random(Range=construct_domain, Number=Slider(7, range=0..10), Seed=number_slider)
panel = Panel(random)
circle = Circle(Plane=PlaneXY(0, 0, 0), Radius=random)
