# Grasshopper definition 11_parametric_tower.gh (Grasshopper 1.0.7)

lower_radius_of_the_tower = Slider(1, range=1..10)
top_radius_of_the_tower = Slider(10, range=1..10)

# ----
# Constructing a tower with variable top and bottom and made up of polygon
floor_height = Slider(3, range=1..10)
no_of_floors = Slider(10, range=1..10)

# ---- group: needed to solve the extra polygon we are getting
# this happens cause series provides the exact numbers of component requested but range provides the extra numbers so to solve this we need to match the number of component we are feeding to the range by -1
number_slider = Slider(1, range=0..1)
integer = Integer(number_slider)
subtraction = Subtraction(A=no_of_floors, B=integer)

# ----
construct_domain = ConstructDomain(DomainStart=lower_radius_of_the_tower, DomainEnd=top_radius_of_the_tower)
series = Series(Start=0, Step=floor_height, Count=no_of_floors)
range = Range(Domain=construct_domain, Steps=subtraction)
construct_point = ConstructPoint(XCoordinate=0, YCoordinate=0, ZCoordinate=series)
sides_of_the_polygon = Slider(3, range=3..12)
polygon = Polygon(Plane=construct_point, Radius=range, Segments=sides_of_the_polygon, FilletRadius=0)  # -> Polygon, Length
loft = Loft(Curves=polygon.Polygon, Options={Adjust=False, Closed=False, LoftEnds=0, LoftSimp=0, LoftType=0, Rebuild=10, Refit=0.01})
cap_holes = CapHoles(Brep=loft)
