# Grasshopper definition 12_sphere.gh (Grasshopper 1.0.7)

populate_3d = Populate3D(Region={Plane=PlaneXY(0, 0, 0), X=Domain(0, 10), Y=Domain(0, 10), Z=Domain(0, 2)}, Count=100, Seed=1)
panel = Panel("Creating a sphere")
sphere = Sphere(Base=populate_3d, Radius=Slider(0.5, range=0..1))
