# Grasshopper definition 13_cylinder.gh (Grasshopper 1.0.7)

xy_plane = XYPlane(Origin=Point(0, 0, 0))
panel = Panel("making a cylinder")
cylinder = Cylinder(Base=xy_plane, Radius=Slider(1, range=1..10), Length=Slider(5, range=1..20))
cap_holes = CapHoles(Brep=cylinder)
