# Grasshopper definition 14_cone.gh (Grasshopper 1.0.7)

panel = Panel("Creating a basic cone")
yz_plane = YZPlane(Origin=Point(0, 0, 0))
cone = Cone(Base=yz_plane, Radius=Slider(1, range=1..100), Length=Slider(2, range=1..100))  # -> Cone, Tip

# ---- group: the sphere will follow the tip of the cone
point = Point(cone.Tip)
sphere = Sphere(Base=point, Radius=1)
