# Grasshopper definition 15_Box.gh (Grasshopper 1.0.7)

panel = Panel("Creating a simple box")
point = Point(<point referenced from the Rhino model>)
center_box = CenterBox(Base=point, X=Slider(1, range=1..100), Y=Slider(10, range=1..100), Z=Slider(6, range=1..100))
