# Grasshopper definition 16_pipe.gh (Grasshopper 1.0.7)

panel = Panel("Creating a Pipe")
curve = Curve(<curve referenced from the Rhino model>)
pipe = Pipe(Curve=curve, Radius=Slider(12, range=12..100), Caps=2)
