# Grasshopper definition 17_moving a geometry.gh (Grasshopper 1.0.7)

panel = Panel("moving a geometry")
cone = Cone(Base=PlaneXY(0, 0, 0), Radius=0.5, Length=1)  # -> Cone, Tip
unit_x = UnitX(Factor=Slider(0, range=0..30))
move = Move(Geometry=cone.Cone, Motion=unit_x)  # -> Geometry, Transform
