# Grasshopper definition 18_moving the plane.gh (Grasshopper 1.0.7)

# moving plane in 3d space
point = Point(<point referenced from the Rhino model>)
yz_plane = YZPlane(Origin=point)
cone = Cone(Base=yz_plane, Radius=Slider(1, range=0..12), Length=Slider(3, range=0..18))  # -> Cone, Tip
