# Grasshopper definition 19_rotating the geometries.gh (Grasshopper 1.0.7)

# rotating the geometry in different axis
xz_plane = XZPlane(Origin=Point(0, 0, 0))
polygon = Polygon(Plane=xz_plane, Radius=3, Segments=6, FilletRadius=0)  # -> Polygon, Length
rotate = Rotate(Geometry=polygon.Polygon, Angle=degrees(Slider(22, range=0..180)), Plane=xz_plane)  # -> Geometry, Transform
