# Grasshopper definition 20_rotating the object based on custom axis.gh (Grasshopper 1.0.7)

geometry = Geometry(<brep referenced from the Rhino model>)
# Rotating the object just using the line
brep = Brep(geometry)
curve = Curve(<curve referenced from the Rhino model>)
rotate_axis = RotateAxis(Geometry=brep, Angle=degrees(Slider(237, range=0..360)), Axis=curve)  # -> Geometry, Transform
polar_array = PolarArray(Geometry=rotate_axis.Geometry, Plane=curve, Count=Slider(20, range=1..100), Angle=6.283185307)  # -> Geometry, Transform
