# Grasshopper definition 21_scale.gh (Grasshopper 1.0.7)

# Creating a custom scaling option for a geometry
xz_plane = XZPlane(Origin=Point(0, 0, 0))
cylinder = Cylinder(Base=xz_plane, Radius=0.5, Length=1)
scale_nu = ScaleNU(
    Geometry=cylinder,
    Plane=PlaneXY(0, 0, 0),
    ScaleX=Slider(33, range=1..100),
    ScaleY=Slider(38, range=1..100),
    ScaleZ=Slider(31, range=1..100))  # -> Geometry, Transform
