# Grasshopper definition Contains_Dyalight_Annual_Everyday.gh (Grasshopper 1.0.7)

# ---- group: For Building Geometry
buildings = Geometry([<brep referenced from the Rhino model> x2])
roomsolid = HBRoomFromSolid(geo=flatten(buildings), conditioned=True)  # -> out, rooms; plug-in component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

# ---- group: For building windows
geometry = Geometry([<brep referenced from the Rhino model> x9])
aperture = HBAperture(geo=geometry)  # -> out, apertures; plug-in component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

# ---- group: For skylight
geometry_2 = Geometry([<brep referenced from the Rhino model> x4])
aperture_2 = HBAperture(geo=geometry_2)  # -> out, apertures; plug-in component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

# ---- group: For building context
geometry_3 = Geometry([<brep referenced from the Rhino model> x2])
shade = HBShade(geo=geometry_3)  # -> out, shades; plug-in component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

# ----
addsubface = HBAddSubface(hb_obj=flatten(roomsolid.rooms), sub_faces=flatten([aperture.apertures, aperture_2.apertures]))  # -> hb_obj; plug-in component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
model = HBModel(rooms=flatten(addsubface), shades=flatten(shade.shades), name="Room by room model")  # -> out, model; plug-in component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
vizbytype = HBVisualizeByType(hb_objs=model.model)  # -> walls, interior_walls, roofs, ceilings, exterior_floors, interior_floors, air_walls, apertures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; plug-in component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
vizwiref = HBVizualizeWireframe(hb_objs=flatten(model.model))  # -> geo; plug-in component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
panel = Panel("https://energyplus-weather.s3.amazonaws.com/southwest_pacific_wmo_region_5/MYS/MYS_Kuala.Lumpur.486470_IWEC/MYS_Kuala.Lumpur.486470_IWEC.zip")
gridrooms = HBSensorGridFromRooms(rooms=model.model, grid_size=Slider(1, range=0..1), dist_floor=Slider(0.07, range=0..0.1))  # -> grid, points, mesh; plug-in component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
custom_preview = CustomPreview(Geometry=vizwiref, Material=ColourSwatch(SwatchColor=RGB(0, 0, 0)))
downloadepw = LBDownloadWeather(weather_URL=panel)  # -> epw_file, stat_file, ddy_file; plug-in component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
assigngridsviews = HBAssignGridsAndViews(model=model.model, grids=flatten(gridrooms.grid))  # -> model; plug-in component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
# Change the theshold according to the desired number of LUX required by the lead system
radpar = HBRadianceParameter(recipe_type=Slider(2, range=0..2), detail_level=Slider(1, range=0..2))  # -> rad_par; plug-in component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
wea = HBWeaFromEPW(epw_file=downloadepw.epw_file)  # -> wea; plug-in component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
annualdaylight = HBAnnualDaylight(model=assigngridsviews, wea=wea, radiance_par=radpar, run=Toggle(True))  # -> out, results, DA, cDA, UDI, UDI_low, UDI_up; plug-in component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

# ---- group: UDI UP
# These are always will be in percentage and not in lux
number_slider = Slider(100, range=0..100)
legendpar = LBLegendParameters(
    min=Slider(0, range=0..100),
    max=number_slider,
    colors=[ColourSwatch(SwatchColor=RGB(255, 255, 255)), ColourSwatch(SwatchColor=RGB(255, 0, 0))],
    num_decimals=Slider(0, range=0..1))  # -> leg_par; plug-in component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
mesh_join = MeshJoin(Meshes=gridrooms.mesh)
data = Data(flatten(annualdaylight.UDI_up))
heatmap = LBSpatialHeatmap(values=data, mesh=mesh_join, legend_par=legendpar, legend_title="%", global_title="UDI UP > 3000")  # -> mesh, legend, title, colors, legend_par; plug-in component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
unit_x = UnitX(Factor=Slider(115, range=0..1000))
move = Move(Geometry=[heatmap.mesh, heatmap.legend, heatmap.title], Motion=unit_x)  # -> Geometry, Transform

# ---- group: UDI
# These are always will be in percentage and not in lux
number_slider_2 = Slider(100, range=0..100)
legendpar_2 = LBLegendParameters(
    min=Slider(0, range=0..100),
    max=number_slider_2,
    colors=[ColourSwatch(SwatchColor=RGB(255, 255, 255)), ColourSwatch(SwatchColor=RGB(172, 255, 167))],
    num_decimals=Slider(0, range=0..1))  # -> leg_par; plug-in component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
mesh_join_2 = MeshJoin(Meshes=gridrooms.mesh)
data_2 = Data(flatten(annualdaylight.UDI))
heatmap_2 = LBSpatialHeatmap(values=data_2, mesh=mesh_join_2, legend_par=legendpar_2, legend_title="%", global_title="UDI 100 - 3000")  # -> mesh, legend, title, colors, legend_par; plug-in component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
unit_x_2 = UnitX(Factor=Slider(35, range=10..1000))
move_2 = Move(Geometry=[heatmap_2.mesh, heatmap_2.legend, heatmap_2.title], Motion=unit_x_2)  # -> Geometry, Transform

# ---- group: LOW UDI
# These are always will be in percentage and not in lux
number_slider_3 = Slider(100, range=0..100)
legendpar_3 = LBLegendParameters(
    min=Slider(0, range=0..100),
    max=number_slider_3,
    colors=[ColourSwatch(SwatchColor=RGB(255, 255, 255)), ColourSwatch(SwatchColor=RGB(0, 80, 167))],
    num_decimals=Slider(0, range=0..1))  # -> leg_par; plug-in component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
mesh_join_3 = MeshJoin(Meshes=gridrooms.mesh)
data_3 = Data(flatten(annualdaylight.UDI_low))
heatmap_3 = LBSpatialHeatmap(values=data_3, mesh=mesh_join_3, legend_par=legendpar_3, legend_title="%", global_title="LOW UDI| UDI<100")  # -> mesh, legend, title, colors, legend_par; plug-in component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
unit_x_3 = UnitX(Factor=Slider(75, range=30..100))
move_3 = Move(Geometry=[heatmap_3.mesh, heatmap_3.legend, heatmap_3.title], Motion=unit_x_3)  # -> Geometry, Transform

# ----
legendpar_4 = LBLegendParameters(min=Slider(0, range=0..100), max=Slider(100, range=0..100), num_decimals=Slider(0, range=0..1))  # -> leg_par; plug-in component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
mesh_join_4 = MeshJoin(Meshes=gridrooms.mesh)
data_4 = Data(flatten(annualdaylight.DA))
# These are always will be in percentage and not in lux
heatmap_4 = LBSpatialHeatmap(values=data_4, mesh=mesh_join_4, legend_par=legendpar_4, legend_title="%", global_title="Daylight Autonomy")  # -> mesh, legend, title, colors, legend_par; plug-in component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
sda = HBSpatialDaylightAutonomy(DA=data_4, mesh=mesh_join_4)  # -> out, sDA, pass_fail; plug-in component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
# This Value shows that out building is 93 percent daylight during the year
panel_2 = Panel(sda.sDA)

# ---- group: Single Day, Day-lighting Study
importloc = LBImportLocation(epw_file=downloadepw.epw_file)  # -> location; plug-in component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
mesh_join_5 = MeshJoin(Meshes=gridrooms.mesh)
radpar_2 = HBRadianceParameter(recipe_type=Slider(0, range=0..2))  # -> rad_par; plug-in component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
ciesky = HBCIEStandardSky(
    location=importloc,
    month=Slider(6, range=1..12),
    day=Slider(21, range=1..31),
    hour=Slider(12, range=0..23),
    type=Slider(0, range=0..5))  # -> sky; plug-in component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
pitgrid = HBPointInTimeGridBased(model=assigngridsviews, sky=ciesky, radiance_par=radpar_2, run=Toggle(True))  # -> out, flatten(results); plug-in component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
legendpar_5 = LBLegendParameters(max=Slider(2000, range=0..10000))  # -> leg_par; plug-in component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
heatmap_5 = LBSpatialHeatmap(values=pitgrid.results, mesh=mesh_join_5, legend_par=legendpar_5, legend_title="Lux")  # -> mesh, legend, title, colors, legend_par; plug-in component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

# ----
unit_y = UnitY(Factor=Slider(30, range=30..100))
move_4 = Move(Geometry=[heatmap_5.title, heatmap_5.mesh, heatmap_5.legend], Motion=unit_y)  # -> Geometry, Transform
