# Grasshopper definition 1.gh (Grasshopper 1.0.7)

# ---- group: 2_Internal LUX / For Building Geometry
buildings = Geometry(<brep referenced from the Rhino model>)
roomsolid = HBRoomFromSolid(geo=flatten(buildings), conditioned=True)  # -> out, rooms; plug-in component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

# ----
geo = Geometry([<brep referenced from the Rhino model> x85])

# ---- group: 2_Internal LUX / For building windows
geometry = Geometry(<brep referenced from the Rhino model>)
aperture = HBAperture(geo=geometry)  # -> out, apertures; plug-in component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

# ---- group: 2_Internal LUX / For skylight
geometry_2 = Geometry([<brep referenced from the Rhino model> x4])
aperture_2 = HBAperture(geo=geometry_2)  # -> out, apertures; plug-in component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

# ---- group: 2_Internal LUX / For building context
geometry_3 = Geometry([<brep referenced from the Rhino model> x2])
shade = HBShade(geo=geo)  # -> out, shades; plug-in component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

# ---- group: 1_outdoor heat gain / Chnage the z value to get 3d graph value of temperature
number_slider = Slider(150, range=0..10000)  # disabled

# ---- group: 1_outdoor heat gain
panel = Panel("https://energyplus-weather.s3.amazonaws.com/southwest_pacific_wmo_region_5/MYS/MYS_Kuala.Lumpur.486470_IWEC/MYS_Kuala.Lumpur.486470_IWEC.zip")  # disabled
downloadepw = LBDownloadWeather(weather_URL=panel)  # -> epw_file, stat_file, ddy_file; disabled; plug-in component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
importepw = LBImportEPW(epw_file=downloadepw.epw_file)  # -> location, dry_bulb_temperature, dew_point_temperature, relative_humidity, wind_speed, wind_direction, direct_normal_rad, diffuse_horizontal_rad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; disabled; plug-in component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
geometry_4 = Geometry(<point referenced from the Rhino model>)  # disabled
number_slider_2 = Slider(1, range=0..1)  # disabled
panel_2 = Panel("seated")  # disabled
solarbodypar = LBSolarBodyParameters(posture=panel_2, absorptivity=number_slider_2)  # -> sol_body_par; disabled; plug-in component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
panel_3 = Panel(importepw.dew_point_temperature)  # disabled
panel_4 = Panel(importepw.dry_bulb_temperature)  # disabled
toggle = BooleanToggle(True)  # disabled
geometry_5 = Geometry(<point referenced from the Rhino model>)  # disabled
toggle_2 = BooleanToggle(True)  # disabled
outdoorsolarmrt = LBOutdoorSolarMRT(
    location=importepw.location,
    surface_temp=importepw.dry_bulb_temperature,
    dir_norm_rad=importepw.direct_normal_rad,
    diff_horiz_rad=importepw.diffuse_horizontal_rad,
    horiz_infrared=importepw.horizontal_infrared_rad,
    solar_body_par=solarbodypar,
    run=toggle)  # -> report, short_erf, long_erf, short_dmrt, long_dmrt, mrt; disabled; plug-in component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
number_slider_3 = Slider(4, range=0..10)  # disabled
number_slider_4 = Slider(1, range=0..5)  # disabled
number_slider_5 = Slider(3, range=1..100)  # disabled

# ---- group: 1_outdoor heat gain / Visualizing skydome
skymatrix = LBCumulativeSkyMatrix(location=importepw.location, direct_rad=importepw.direct_normal_rad, diffuse_rad=importepw.diffuse_horizontal_rad)  # -> report, sky_mtx; disabled; plug-in component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
skydome = LBSkyDome(sky_mtx=skymatrix.sky_mtx, center_pt=geometry_4)  # -> report, mesh, compass, legend, title, patch_vecs, patch_values, mesh_values; disabled; plug-in component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

# ---- group: 1_outdoor heat gain / sunpath diagram
number_slider_6 = Slider(1, range=1..12)  # disabled
number_slider_7 = Slider(12, range=0..23)  # disabled
number_slider_8 = Slider(0, range=0..360)  # disabled
analysisperiod = LBAnalysisPeriod(start_month=number_slider_6, start_day=1, start_hour=0, end_month=number_slider_7)  # -> period, hoys, dates; disabled; plug-in component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
sunpath = LBSunPath(
    north=number_slider_8,
    location=importepw.location,
    hoys=analysisperiod.hoys,
    center_pt=geometry_5,
    scale=number_slider_3)  # -> report, vectors, altitudes, azimuths, hoys, sun_pts, analemma, daily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; disabled; plug-in component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

# ---- group: 1_outdoor heat gain / Wind Rose
geo_2 = Geometry(<point referenced from the Rhino model>)  # disabled
windrose = LBWindRose(data=importepw.wind_speed, wind_direction=importepw.wind_direction, center_pt=geo_2)  # -> report, mesh, compass, orient_line, freq_line, windrose_line, legend, title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; disabled; plug-in component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

# ---- group: 1_outdoor heat gain / heat map signature
geo_3 = Geometry(<point referenced from the Rhino model>)  # disabled
hourlyplot = LBHourlyPlot(data=importepw.dry_bulb_temperature, base_pt=geo_3, z_dim=number_slider)  # -> report, mesh, legend, borders, labels, title; disabled; plug-in component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

# ---- group: 1_outdoor heat gain / Sun + Wind
utci = LBUTCIComfort(
    air_temp=importepw.dry_bulb_temperature,
    mrt=outdoorsolarmrt.mrt,
    rel_humid=importepw.relative_humidity,
    wind_vel=importepw.wind_speed,
    run=toggle_2)  # -> report, utci, comfort, condition, category, comf_obj; disabled; plug-in component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

# ---- group: 1_outdoor heat gain / No Sun + Wind
utci_2 = LBUTCIComfort(
    air_temp=importepw.dry_bulb_temperature,
    rel_humid=importepw.relative_humidity,
    wind_vel=importepw.wind_speed,
    run=toggle_2)  # -> report, utci, comfort, condition, category, comf_obj; disabled; plug-in component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

# ---- group: 1_outdoor heat gain / Sun + No Wind
utci_3 = LBUTCIComfort(
    air_temp=importepw.dry_bulb_temperature,
    rel_humid=importepw.relative_humidity,
    wind_vel=importepw.wind_speed,
    run=toggle_2)  # -> report, utci, comfort, condition, category, comf_obj; disabled; plug-in component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

# ---- group: 1_outdoor heat gain / No Sun + No Wind
utci_4 = LBUTCIComfort(
    air_temp=importepw.dry_bulb_temperature,
    rel_humid=importepw.relative_humidity,
    wind_vel=importepw.wind_speed,
    run=toggle_2)  # -> report, utci, comfort, condition, category, comf_obj; disabled; plug-in component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

# ---- group: 1_outdoor heat gain / Site Area with model solar analysis
toggle_3 = BooleanToggle(True)  # disabled
geo_4 = Geometry([<brep referenced from the Rhino model> x85])  # disabled
geo_5 = Geometry(<mesh referenced from the Rhino model>)  # disabled
geo_6 = Geometry(<brep referenced from the Rhino model>)  # disabled
directsunhours = LBDirectSunHours(
    vectors=flatten(sunpath.vectors),
    geometry=flatten([geo_6, geo_5]),
    context=flatten(geo_4),
    grid_size=number_slider_4,
    run=toggle_3)  # -> report, points, results, mesh, legend, title, int_mtx; disabled; plug-in component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

# ---- group: 1_outdoor heat gain (continued)
incidentradiation = LBIncidentRadiation(geometry=flatten([geo_5, geo_6]), context=flatten(geo_4), grid_size=number_slider_5, run=toggle_3)  # -> report, points, results, total, mesh, legend, title, int_mtx; disabled; plug-in component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
hourlyplot_2 = LBHourlyPlot(data=[utci.utci, utci_2.utci, utci_3.utci, utci_4.utci], base_pt=geo_3, z_dim=number_slider)  # -> report, mesh, legend, borders, labels, title; disabled; plug-in component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

# ---- group: 2_Internal LUX
# This Value shows that out building is 93 percent daylight during the year
# Change the theshold according to the desired number of LUX required by the lead system
# These are always will be in percentage and not in lux
addsubface = HBAddSubface(hb_obj=flatten(roomsolid.rooms), sub_faces=flatten([aperture.apertures, aperture_2.apertures]))  # -> hb_obj; plug-in component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
model = HBModel(rooms=flatten(addsubface), shades=flatten(shade.shades), name="Room by room model")  # -> out, model; plug-in component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
vizbytype = HBVisualizeByType(hb_objs=model.model)  # -> walls, interior_walls, roofs, ceilings, exterior_floors, interior_floors, air_walls, apertures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; plug-in component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
vizwiref = HBVizualizeWireframe(hb_objs=flatten(model.model))  # -> geo; plug-in component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
gridrooms = HBSensorGridFromRooms(rooms=model.model, grid_size=Slider(1, range=0..1), dist_floor=Slider(0.07, range=0..0.1))  # -> grid, points, mesh; plug-in component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
panel_5 = Panel("https://energyplus-weather.s3.amazonaws.com/southwest_pacific_wmo_region_5/MYS/MYS_Kuala.Lumpur.486470_IWEC/MYS_Kuala.Lumpur.486470_IWEC.zip")
custom_preview = CustomPreview(Geometry=vizwiref, Material=ColourSwatch(SwatchColor=RGB(0, 0, 0)))
downloadepw_2 = LBDownloadWeather(weather_URL=panel_5)  # -> epw_file, stat_file, ddy_file; plug-in component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
assigngridsviews = HBAssignGridsAndViews(model=model.model, grids=flatten(gridrooms.grid))  # -> model; plug-in component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
radpar = HBRadianceParameter(recipe_type=Slider(2, range=0..2), detail_level=Slider(1, range=0..2))  # -> rad_par; plug-in component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
wea = HBWeaFromEPW(epw_file=downloadepw_2.epw_file)  # -> wea; plug-in component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
annualdaylight = HBAnnualDaylight(model=assigngridsviews, wea=wea, radiance_par=radpar, run=Toggle(True))  # -> out, results, DA, cDA, UDI, UDI_low, UDI_up; plug-in component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
legendpar = LBLegendParameters(min=Slider(0, range=0..100), max=Slider(100, range=0..100), num_decimals=Slider(0, range=0..1))  # -> leg_par; plug-in component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
mesh_join = MeshJoin(Meshes=gridrooms.mesh)
data = Data(flatten(annualdaylight.DA))
heatmap = LBSpatialHeatmap(values=data, mesh=mesh_join, legend_par=legendpar, legend_title="%", global_title="Daylight Autonomy")  # -> mesh, legend, title, colors, legend_par; plug-in component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
sda = HBSpatialDaylightAutonomy(DA=data, mesh=mesh_join)  # -> out, sDA, pass_fail; plug-in component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
panel_6 = Panel(sda.sDA)
unit_y = UnitY(Factor=Slider(30, range=30..100))

# ---- group: 2_Internal LUX / UDI UP
# These are always will be in percentage and not in lux
number_slider_9 = Slider(100, range=0..100)
legendpar_2 = LBLegendParameters(
    min=Slider(0, range=0..100),
    max=number_slider_9,
    colors=[ColourSwatch(SwatchColor=RGB(255, 255, 255)), ColourSwatch(SwatchColor=RGB(255, 0, 0))],
    num_decimals=Slider(0, range=0..1))  # -> leg_par; plug-in component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
mesh_join_2 = MeshJoin(Meshes=gridrooms.mesh)
data_2 = Data(flatten(annualdaylight.UDI_up))
heatmap_2 = LBSpatialHeatmap(values=data_2, mesh=mesh_join_2, legend_par=legendpar_2, legend_title="%", global_title="UDI UP > 3000")  # -> mesh, legend, title, colors, legend_par; plug-in component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
unit_x = UnitX(Factor=Slider(115, range=0..1000))
move = Move(Geometry=[heatmap_2.mesh, heatmap_2.legend, heatmap_2.title], Motion=unit_x)  # -> Geometry, Transform

# ---- group: 2_Internal LUX / UDI
# These are always will be in percentage and not in lux
number_slider_10 = Slider(100, range=0..100)
legendpar_3 = LBLegendParameters(
    min=Slider(0, range=0..100),
    max=number_slider_10,
    colors=[ColourSwatch(SwatchColor=RGB(255, 255, 255)), ColourSwatch(SwatchColor=RGB(172, 255, 167))],
    num_decimals=Slider(0, range=0..1))  # -> leg_par; plug-in component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
mesh_join_3 = MeshJoin(Meshes=gridrooms.mesh)
data_3 = Data(flatten(annualdaylight.UDI))
heatmap_3 = LBSpatialHeatmap(values=data_3, mesh=mesh_join_3, legend_par=legendpar_3, legend_title="%", global_title="UDI 100 - 3000")  # -> mesh, legend, title, colors, legend_par; plug-in component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
unit_x_2 = UnitX(Factor=Slider(35, range=10..1000))
move_2 = Move(Geometry=[heatmap_3.mesh, heatmap_3.legend, heatmap_3.title], Motion=unit_x_2)  # -> Geometry, Transform

# ---- group: 2_Internal LUX / LOW UDI
# These are always will be in percentage and not in lux
number_slider_11 = Slider(100, range=0..100)
legendpar_4 = LBLegendParameters(
    min=Slider(0, range=0..100),
    max=number_slider_11,
    colors=[ColourSwatch(SwatchColor=RGB(255, 255, 255)), ColourSwatch(SwatchColor=RGB(0, 80, 167))],
    num_decimals=Slider(0, range=0..1))  # -> leg_par; plug-in component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
mesh_join_4 = MeshJoin(Meshes=gridrooms.mesh)
data_4 = Data(flatten(annualdaylight.UDI_low))
heatmap_4 = LBSpatialHeatmap(values=data_4, mesh=mesh_join_4, legend_par=legendpar_4, legend_title="%", global_title="LOW UDI| UDI<100")  # -> mesh, legend, title, colors, legend_par; plug-in component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
unit_x_3 = UnitX(Factor=Slider(75, range=30..100))
move_3 = Move(Geometry=[heatmap_4.mesh, heatmap_4.legend, heatmap_4.title], Motion=unit_x_3)  # -> Geometry, Transform

# ---- group: 2_Internal LUX / Single Day, Day-lighting Study
importloc = LBImportLocation(epw_file=downloadepw_2.epw_file)  # -> location; plug-in component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
mesh_join_5 = MeshJoin(Meshes=gridrooms.mesh)
radpar_2 = HBRadianceParameter(recipe_type=Slider(0, range=0..2))  # -> rad_par; plug-in component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
ciesky = HBCIEStandardSky(
    location=importloc,
    month=Slider(6, range=1..12),
    day=Slider(21, range=1..31),
    hour=Slider(12, range=0..23),
    type=Slider(0, range=0..5))  # -> sky; plug-in component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
pitgrid = HBPointInTimeGridBased(model=assigngridsviews, sky=ciesky, radiance_par=radpar_2, run=Toggle(True))  # -> out, flatten(results); plug-in component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
legendpar_5 = LBLegendParameters(max=Slider(2000, range=0..10000))  # -> leg_par; plug-in component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
heatmap_5 = LBSpatialHeatmap(values=pitgrid.results, mesh=mesh_join_5, legend_par=legendpar_5, legend_title="Lux")  # -> mesh, legend, title, colors, legend_par; plug-in component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

# ---- group: 2_Internal LUX (continued)
move_4 = Move(Geometry=[heatmap_5.title, heatmap_5.mesh, heatmap_5.legend], Motion=unit_y)  # -> Geometry, Transform
