# Grasshopper definition 2.gh (Grasshopper 1.0.7)

# ---- group: Base Geometry
geo = Geometry([<brep referenced from the Rhino model> x3])

# ---- group: Window
geo_2 = Geometry([<brep referenced from the Rhino model> x9])

# ---- group: Door
geo_3 = Geometry([<brep referenced from the Rhino model> x2])

# ----
intsolid = HBIntersectSolids(solids=flatten(geo), run=Toggle(True))  # -> int_solids; plug-in component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
roomsolid = HBRoomFromSolid(geo=flatten(intsolid), conditioned=True)  # -> report, rooms; plug-in component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
door = HBDoor(geo=geo_3)  # -> report, doors; plug-in component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
aperture = HBAperture(geo=geo_2)  # -> report, apertures; plug-in component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
solveadj = HBSolveAdjacency(rooms=flatten(roomsolid.rooms), run=Toggle(True))  # -> report, adj_rooms; plug-in component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
addsubface = HBAddSubface(hb_obj=flatten(solveadj.adj_rooms), sub_faces=flatten([aperture.apertures, door.report]))  # -> hb_obj; plug-in component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
vizbytype = HBVisualizeByType(hb_objs=[roomsolid.rooms, addsubface])  # -> walls, interior_walls, roofs, ceilings, exterior_floors, interior_floors, air_walls, apertures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; plug-in component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
geo_4 = Geometry([vizbytype.walls, vizbytype.interior_walls, vizbytype.roofs])
